# Grasshopper definition snowflake.gh (Grasshopper 1.0.7)
# plug-ins: Pufferfish

ориентация_веточек = Slider(9, range=-15..15)
количество_веточек = Slider(3, range=1..10)
количество_лучей = Slider(7, range=0..30)
размер_веточек = Slider(0.8, range=0..1)
длина_веточек = Slider(7, range=0..10)
толщина_луча = Slider(5, range=3..10)
длина_луча = Slider(59, range=0..75)

pt = ConstructPoint(XCoordinate=0, YCoordinate=0, ZCoordinate=0)
Y = UnitY(Factor=ориентация_веточек)
line = LineSDL(Start=pt, Direction=Vector(0, 1, 0), Length=длина_луча)
divide = DivideCurve(Curve=line, Count=количество_веточек, Kinks=False)  # -> Points, Tangents, Parameters
move = Move(Geometry=divide.Points, Motion=Y)  # -> Geometry, Transform
X = UnitX(Factor=длина_веточек)
move_2 = Move(Geometry=move.Geometry, Motion=X)  # -> Geometry, Transform
ln = Line(StartPoint=move_2.Geometry, EndPoint=divide.Points)
cull_i = CullIndex(List=ln, Indices=0, Wrap=True)
scale = Scale(Geometry=cull_i, Center=divide.Points, Factor=размер_веточек)  # -> Geometry, Transform
mirror = Mirror(Geometry=scale.Geometry, Plane=PlaneYZ(0, 0, 0))  # -> Geometry, Transform
merge = Merge(Data1=mirror.Geometry, Data2=scale.Geometry, Data3=line)
arrpolar = PolarArray(Geometry=merge, Plane=PlaneXY(0, 0, 0), Count=количество_лучей, Angle=6.283185307)  # -> Geometry, Transform
join = JoinCurves(Curves=flatten(arrpolar.Geometry), Preserve=False)
offcrv = OffsetCurve(Curve=join, Distance=толщина_луча, Plane=PlaneXY(0, 0, 0), BothSides=True, Kinks=0, CapType=Slider(3, range=0..3))  # -> flatten(Offset)

runion = RegionUnion(Curves=offcrv)
dam = DataDam(DataA=runion, BufferDelay=10000000, BufferMode=0)

Z = UnitZ(Factor=Slider(3, range=0..10))
extr = Extrude(Base=dam, Direction=Z)
cap = CapHoles(Brep=extr)
preview = CustomPreview(
    Geometry=cap,
    Material={diffuse=RGB(221, 160, 221), emission=RGB(66, 48, 66), shine=0.5, specular=RGB(255, 255, 255), transparency=0})
